# Grasshopper definition legoPaint_v6.gh (Grasshopper 1.0.7)
# plug-ins: EleFront

imagepath = FilePath("C:\GitHub\qr-art.github.io\LegoPaint\photos\midjourney\mp_pelle_abstract_face_5_colors_square_image_32115072-aa3e-4a24-a6ce-eb83fcf8a2e5.png")
imagepath_2 = FilePath("C:\GitHub\qr-art.github.io\LegoPaint\photos\girl-2696947__480.jpg")
imagepath_3 = FilePath("C:\GitHub\qr-art.github.io\LegoPaint\photos\abstract_square.jpg")
image_resource = ImageResource(imagepath_2)
image_resource_2 = ImageResource(imagepath)
image_resource_3 = ImageResource(imagepath_3)
python = GhPythonScript(FilePath=image_resource_2)  # -> out, FilePath, image, resolution_x, resolution_y
# ---------- python: Python ----------
__author__ = "Marco"
__version__ = "2022.11.19"

import rhinoscriptsyntax as rs
from System.Drawing import Color, Bitmap
import Rhino.Geometry as rg

image = Bitmap(FilePath)

resolution_x = image.Width
resolution_y = image.Height

image.Dispose()
# ---------- end python ----------
panel = Panel(python.resolution_y)
panel_2 = Panel(python.resolution_x)
division = Division(A=panel_2, B=panel)
panel_3 = Panel(division)
multiplication = Multiplication(A="48", B=panel_3)
num = Number("48")
num_2 = Number(multiplication)
c_script = CSharpScript(filepath=python.FilePath, x=num, y="48")  # -> out, ResizedImage, ResolutionX, ResolutionY, preview; inputs filepath: String, x: Int32, y: Int32
# ---------- c_script: C# usings ----------
using System.Drawing.Configuration;
using System.Drawing;
using System.Drawing.Imaging;
using System.Drawing.Drawing2D;
# ---------- c_script: C# ----------
    var image = System.Drawing.Image.FromFile(filepath);
    var oImage = ResizeImage(image, x, y);

    var filePath = @"C:\GitHub\qr-art.github.io\LegoPaint\photos\Shapes1001.jpg";
    oImage.Save(filePath);
    ResolutionX = oImage.Width;
    ResolutionY = oImage.Height;
    preview = filePath;
    ResizedImage = oImage;
# ---------- c_script: C# additional code ----------
  /// <summary>
  /// Resize the image to the specified width and height.
  /// </summary>
  /// <param name="image">The image to resize.</param>
  /// <param name="width">The width to resize to.</param>
  /// <param name="height">The height to resize to.</param>
  /// <returns>The resized image.</returns>
  public static Bitmap ResizeImage(Image image, int width, int height)
  {
    var destRect = new Rectangle(0, 0, width, height);
    var destImage = new Bitmap(width, height);

    destImage.SetResolution(image.HorizontalResolution, image.VerticalResolution);
    using (var graphics = Graphics.FromImage(destImage))
    {
      graphics.CompositingMode = CompositingMode.SourceCopy;
      graphics.CompositingQuality = CompositingQuality.HighQuality;
      graphics.InterpolationMode = InterpolationMode.HighQualityBicubic;
      graphics.SmoothingMode = SmoothingMode.HighQuality;
      graphics.PixelOffsetMode = PixelOffsetMode.HighQuality;

      using (var wrapMode = new ImageAttributes())
      {
        wrapMode.SetWrapMode(WrapMode.TileFlipXY);
        graphics.DrawImage(image, destRect, 0, 0, image.Width, image.Height, GraphicsUnit.Pixel, wrapMode);
      }
    }

    return destImage;
  }
# ---------- end c_script ----------
image_resource_4 = ImageResource(c_script.preview)
panel_4 = Panel("2")

fsdither = PythonicFloydSteinbergDithering(image=c_script.ResizedImage, ResolutionX="1", ResolutionY="1", Factor="200")  # -> out, Bounds, Points, Colors; inputs ResolutionX: Int32, ResolutionY: Int32
# ---------- fsdither: Python ----------
"""Pythonic Floyd-Steinberg Image Dithering Algorithm.
    ---
    The algorithm was first published in 1976 by Robert W. Floyd and Louis Steinberg. 
    It is commonly used by image manipulation software, for example when an image is 
    converted into GIF format that is restricted to a maximum of 256 colors. 
    ---
    See also https://en.wikipedia.org/wiki/Floyd%E2%80%93Steinberg_dithering .

    Inputs:
        FilePath: Absolute file path of an image.
        ResolutionX: Resolution frequency in the image x-direction.
            ---
            A lower value equals a higher resolution and thus longer processing times.
            For instance, a frequency of 1 selects each pixel of the original image,
            whereas a frequency of 2 reproduces only every second pixel and so fourth.
            For a rectangular image ResolutionX and ResolutionY should be adjusted
            manually to get an equal pixel distribution in both directions.
            For a square image both resolution inputs should be equal.
        ResolutionY: Resolution frequency in the image y-direction.
            ---
            A lower value equals a higher resolution and thus longer processing times.
            For instance, a frequency of 1 selects each pixel of the original image,
            whereas a frequency of 2 reproduces only every second pixel and so fourth.
            For a rectangular image ResolutionY and ResolutionX should be adjusted
            manually to get an equal pixel distribution in both directions.
            For a square image both resolution inputs should be equal.
        Factor: Quantization factor restricts the maximum number of colors.
    Output:
        Bounds: Boundary of the image as rectangle.
        Points: List of pixel positions.
        Colors: List of pixel colors."""


ghenv.Component.Name = "Pythonic Floyd-Steinberg Dithering"
ghenv.Component.NickName = "FSDither"

__author__ = "p1r4t3b0y"


from System.Drawing import Color, Bitmap
import Rhino.Geometry as rg


class FloydSteinbergDithering:
    """Floyd-Steinberg image dithering algorithm.

    Attributes:
        image: An image as instance of System.Drawing.Bitmap().
        resolution_x: An integer resolution frequency in the image x-direction.
        resolution_y: An integer resolution frequency in the image y-direction.
        factor: An integer quantization factor that restricts the maximum number of colors.
    """
    
    def __init__(self, image, resolution_x, resolution_y, factor):
        """Initialises the FloydSteinbergDithering class."""
        self.image = image
        self.width = image.Width
        self.height = image.Height
        self.resolution_x = resolution_x
        self.resolution_y = resolution_y
        self.factor = factor
        self.points = []
        self.pixels = []
      
        
    def _create_points(self):
        """Creates a nested list of 2-dimensional points for an image resolution in x- and y-direction."""  
        for y in reversed(range(self.height)):
            # reversed loop to match pixel order to prevent mirrored image display
            if y % self.resolution_y == 0:
                row_pts = []
                for x in range(self.width):
                    if x % self.resolution_x == 0:
                        row_pts.append(rg.Point2d(x, y))
                self.points.append(row_pts)
    
    
    def _create_pixels(self):
        """Creates a nested list of pixel colors for an image resolution in x- and y-direction."""  
        for y in range(self.height):
            if y % self.resolution_y == 0:
                row_pxls = []
                for x in range(self.width):
                    if x % self.resolution_x == 0:
                        row_pxls.append(image.GetPixel(x, y))
                self.pixels.append(row_pxls)
    
    
    def dither(self):
        """Achieves dithering of an image using error diffusion, meaning it pushes or adds the residual 
            quantization error of a pixel onto its neighboring pixels, to be dealt with later."""
        
        
        def restrict_rgb_value(value):
            """Restricts a color value to the RGB color bounds.
        
            Args:
              value: Integer color value.
            Returns:
              The color value between 0 and 255.
            """
            if value > 255:
                return 255
            elif value < 0:
                return 0
            else:
                return value
        
        
        # Initialise the points and pixels
        self._create_points()
        self._create_pixels() # colors
        
        for y in range(len(self.pixels) - 1): # for each y from top to bottom
            for x in range(1, len(self.pixels[y]) - 1): # for each x from left to right
                pix = self.pixels[y][x]
                
                # Get the initial color values
                init_a = pix.A # alpha value
                init_r = pix.R # red value
                init_g = pix.G # green value
                init_b = pix.B # blue value
                
                # Quantize the color values to a lower number of possibilities
                quant_r = int(round(int(self.factor) * init_r / 255)) * (255 / int(self.factor))
                quant_g = int(round(int(self.factor) * init_g / 255)) * (255 / int(self.factor))
                quant_b = int(round(int(self.factor) * init_b / 255)) * (255 / int(self.factor))
                self.pixels[y][x] = Color.FromArgb(init_a, quant_r, quant_g, quant_b)
                
                # Calculate error diffusion values
                err_r = init_r - quant_r
                err_g = init_g - quant_g
                err_b = init_b - quant_b
                
                # Dithering step 1
                r = restrict_rgb_value(self.pixels[y   ][x + 1].R + err_r * 7 / 16.0)
                g = restrict_rgb_value(self.pixels[y   ][x + 1].G + err_r * 7 / 16.0)
                b = restrict_rgb_value(self.pixels[y   ][x + 1].B + err_r * 7 / 16.0)
                self.pixels[y][x + 1] = Color.FromArgb(init_a, r, g, b)
                
                # Dithering step 2
                r = restrict_rgb_value(self.pixels[y + 1][x - 1].R + err_r * 3 / 16.0)
                g = restrict_rgb_value(self.pixels[y + 1][x - 1].G + err_r * 3 / 16.0)
                b = restrict_rgb_value(self.pixels[y + 1][x - 1].B + err_r * 3 / 16.0)
                self.pixels[y + 1][x - 1] = Color.FromArgb(init_a, r, g, b)
                
                # Dithering step 3
                r = restrict_rgb_value(self.pixels[y + 1][x   ].R + err_r * 5 / 16.0)
                g = restrict_rgb_value(self.pixels[y + 1][x   ].G + err_r * 5 / 16.0)
                b = restrict_rgb_value(self.pixels[y + 1][x   ].B + err_r * 5 / 16.0)
                self.pixels[y + 1][x   ] = Color.FromArgb(init_a, r, g, b)
                
                # Dithering step 4
                r = restrict_rgb_value(self.pixels[y + 1][x + 1].R + err_r * 1 / 16.0)
                g = restrict_rgb_value(self.pixels[y + 1][x + 1].G + err_r * 1 / 16.0)
                b = restrict_rgb_value(self.pixels[y + 1][x + 1].B + err_r * 1 / 16.0)
                self.pixels[y + 1][x + 1] = Color.FromArgb(init_a, r, g, b)
     
                            
    def get_points(self):
        """Returns a flat list of 2-dimensional points."""
        return [pt for lt in self.points for pt in lt]
    
    
    def get_pixels(self):
        """Returns a flat list of pixel colors."""
        return [px for lt in self.pixels for px in lt]
    
    
    def get_boundary(self):
        """Returns the image boundary as a rectangle."""
        origin = rg.Point3d(0, 0, 0)
        dir_x = rg.Vector3d(self.width, 0, 0)
        dir_y = rg.Vector3d(0, self.height, 0)
        plane = rg.Plane(origin, dir_x, dir_y)
        return rg.Rectangle3d(plane, self.width, self.height)


######################################################################################


if __name__ == "__main__":
    # Initialise image
    
    # Initialise and run FloydSteinbergDithering
    print ResolutionX
    fs = FloydSteinbergDithering(image, int(ResolutionX), int(ResolutionY), int(Factor))
    fs.dither()
    
    # Output result
    Bounds = fs.get_boundary()
    Points = fs.get_points()
    Colors = fs.get_pixels()
    
    # Display stats
    print "IMAGE STATS"
    if fs.width == fs.height: print " Type: Square"
    else: print " Type: Rectangle"
    print " Width: %d units" %(fs.width)
    print " Height: %d units" %(fs.height)
    print "\t"
    
    print "DITHERING STATS"
    print " Width: %d px" %(len(fs.pixels[0]))
    print " Height: %d px" %(len(fs.get_pixels()) / len(fs.pixels[0]))
    print " No. Pixels: %d px" %(len(fs.get_pixels()))
# ---------- end fsdither ----------
console = Panel(fsdither.out)

panel_5 = Panel(fsdither.Bounds)
division_2 = Division(A="385", B="48")
points = Point(fsdither.Points)
scale_nu = ScaleNU(Geometry=points, Plane=PlaneXY(0, 0, 0), ScaleX=division_2, ScaleY=division_2, ScaleZ=1)  # -> Geometry, Transform
mesh = Mesh(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)

inblock = InsertBlock(BlockName="1 stub mesh", SourcePlane=PlaneXY(0, 0, 0))
deblock = DeconstructBlock(Block=inblock)  # -> Name, Plane, Geometry
mjoin = MeshJoin(Meshes=mesh)
orient = Orient(Geometry=mjoin, Source=PlaneXY(0, 0, 0), Target=scale_nu.Geometry)  # -> flatten(Geometry), Transform

ghpython_script = GhPythonScript()  # -> out, r, g, b
# ---------- ghpython_script: Python ----------
colors =    {1:"124,92,66",
             2: "126,156,134",
             3: "102,43,50",
             4:  "80,44,25",
             5: "147,148,147",
             6: "101,101,101",
             7: "209,130,60",
             8: "83,161,90",
             9: "174,37,26",
             10: "130,95,154",
             11: "42,60,99",
             12: "237,199,67",
             13: "53,96,171",
             14: "176,163,118",
             15: "76,76,76",
             16: "215,215,215",
             17: "133,79,53",
             18: "164,182,215",
             19: "233,184,154",
             20: "58,81,61",
             21: "72,126,167",
             22: "159,188,83",
             23: "87,68,141",
             24: "198,68,156",
             25: "65,137,133",
             26: "61,47,21",
             27: "108,156,180",
             28: "132,64,120",
             29: "185,205,200",
             30: "248,226,129",
             31: "103,108,55",
             32: "228,154,197",
             33: "228,162,68",
             34: "5,5,5",
             35: "255,255,255"}

keys = colors.keys()

r = []
g = []
b = []

for i in keys:
    a = colors[i]

    items = a.split(",")

    r.append( items[0] )
    g.append( items[1] )
    b.append( items[2] )
# ---------- end ghpython_script ----------
colour_rgb = ColourRGB(Alpha=255, Red=ghpython_script.r, Green=ghpython_script.g, Blue=ghpython_script.b)
col = Colour(colour_rgb)

python_2 = GhPythonScript(colorsList=col)  # -> out, C, T; inputs colorsList: list
# ---------- python_2: Python ----------
__author__ = "Marco"
__version__ = "2022.11.22"

import rhinoscriptsyntax as rs

C = colorsList

T = []
for i, color in enumerate(colorsList):
    text = "{} - {} {} {}".format(i, color.R, color.G, color.B)
    T.append(text)
# ---------- end python_2 ----------

legend = Legend(Colour=python_2.C, Tags=python_2.T, LegendType=1)

list = ValueList({"rgb": 0, "hsv": 1}, selected="rgb")
colors = Colour(fsdither.Colors)
col_2 = Colour(col)
argb = SplitARGB(Colour=colors)  # -> Alpha, Red, Green, Blue
argb_2 = SplitARGB(Colour=col_2)  # -> Alpha, Red, Green, Blue
python_3 = GhPythonScript(x=argb_2.Red, y=argb_2.Green, z=argb_2.Blue)  # -> out, a, b, c
# ---------- python_3: Python ----------
__author__ = "Marco"
__version__ = "2022.11.19"

import rhinoscriptsyntax as rs

def rgb_to_hsv(r, g, b):
    r = float(r)
    g = float(g)
    b = float(b)
    high = max(r, g, b)
    low = min(r, g, b)
    h, s, v = high, high, high

    d = high - low
    s = 0 if high == 0 else d/high

    if high == low:
        h = 0.0
    else:
        h = {
            r: (g - b) / d + (6 if g < b else 0),
            g: (b - r) / d + 2,
            b: (r - g) / d + 4,
        }[high]
        h /= 6

    return h, s, v

a,b,c = rgb_to_hsv(x,y,z)
# ---------- end python_3 ----------
python_4 = GhPythonScript(x=argb.Red, y=argb.Green, z=argb.Blue)  # -> out, a, b, c; same code as python_3
pt = ConstructPoint(XCoordinate=argb_2.Red, YCoordinate=argb_2.Green, ZCoordinate=argb_2.Blue)
pt_2 = ConstructPoint(XCoordinate=python_3.a, YCoordinate=python_3.b, ZCoordinate=python_3.c)
pt_3 = ConstructPoint(XCoordinate=argb.Red, YCoordinate=argb.Green, ZCoordinate=argb.Blue)
pt_4 = ConstructPoint(XCoordinate=python_4.a, YCoordinate=python_4.b, ZCoordinate=python_4.c)
filter = StreamFilter(Gate=list, Stream0=pt, Stream1=pt_2)
filter_2 = StreamFilter(Gate=list, Stream0=pt_3, Stream1=pt_4)
cp = ClosestPoint(Point=filter_2, Cloud=filter)  # -> ClosestPoint, CPIndex, Distance
item = ListItem(List=col_2, Index=cp.CPIndex, Wrap=True)
col_3 = Colour(item)

col_4 = Colour(col_3)
cset = CreateSet(List=col_4)  # -> Set, Map
mindex = MemberIndex(Set=col_4, Member=cset.Set)  # -> simplify(Index), Count
preview = CustomPreview(Geometry=orient.Geometry, Material=col_3)
python_5 = GhPythonScript(x=cset.Set, y=mindex.Count)  # -> flatten(out), color, amount, T
# ---------- python_5: Python ----------
__author__ = "Marco"
__version__ = "2022.11.21"

import rhinoscriptsyntax as rs

description = "Color {},{},{} - {}".format(x.R, x.G, x.B, y)
print description
color = x
amount = y


T = "{:<8} -{},{},{}".format(amount, x.R, x.G, x.B)
# ---------- end python_5 ----------
ma = MassAddition(Input=python_5.amount)  # -> Result, PartialResults
legend_2 = Legend(Colour=python_5.color, Tags=python_5.T, LegendType=1)
multiplication_2 = Multiplication(A=ma.Result, B="0.06")
cost = Panel(multiplication_2)
panel_6 = Panel(python_5.out)
