# Grasshopper definition woman_2.gh (Grasshopper 1.0.7)
# plug-ins: Weaverbird, Javid, MeshEdit Components, Alpaca4d

path = FilePath("/Users/mp/Documents/GitHub/qr-art.github.io/pixel-art/assets/woman.jpg")
open = OpenBitmap(File=path)
preview_bitmap = PreviewBitmap(Bitmap=open, LockAspect=False)
python = GhPythonScript(x=open)  # -> out, a, b
# ---------- python: Python ----------
__author__ = "mp"

import rhinoscriptsyntax as rs

a = x.Width
b = x.Height
# ---------- end python ----------
panel = Panel(python.a)
panel_2 = Panel(python.b)
dice_dimension_mm = Panel("10")
target_width_mm = Panel("900")
division = Division(A=panel, B=panel_2)
target_heigth_mm = Panel("1400")
list = ValueList({"width input": 0, "picture ration": 1}, selected="width input")
division_2 = Division(A=target_width_mm, B=division)
filter = StreamFilter(Gate=list, Stream0=target_heigth_mm, Stream1=division_2)
division_3 = Division(A=target_width_mm, B=dice_dimension_mm)
division_4 = Division(A=filter, B=dice_dimension_mm)
range = Range(Domain=filter, Steps=division_4)
range_2 = Range(Domain=target_width_mm, Steps=division_3)
crv = Curve([<curve referenced from the Rhino model> x2])
crv_2 = Curve([<curve referenced from the Rhino model> x3])
crv_3 = Curve([<curve referenced from the Rhino model> x4])
crv_4 = Curve([<curve referenced from the Rhino model> x5])
crv_5 = Curve([<curve referenced from the Rhino model> x6])
crv_6 = Curve([<curve referenced from the Rhino model> x7])
lng = ListLength(List=range_2)
lng_2 = ListLength(List=range)
crv_7 = Curve(<curve referenced from the Rhino model>)
num = Number(expr("x-1", lng))
num_2 = Number(expr("x-1", lng_2))
entwine = Entwine(
    Branch00=crv_7,
    Branch01=crv,
    Branch02=crv_2,
    Branch03=crv_3,
    Branch04=crv_4,
    Branch05=crv_5,
    Branch06=crv_6,
    FlattenInputs=True)
len = Length(Curve=entwine)
sort = SortList(Keys=len, ValuesA=entwine)  # -> Keys, reverse(ValuesA)
range_3 = Range(Domain=Domain(0, 1), Steps=expr("x-1", num_2))
range_4 = Range(Domain=Domain(0, 1), Steps=expr("x-1", num))
srf = Surface(sort.ValuesA)
vec = VectorXYZ(XComponent=graft(range_4), YComponent=range_3, ZComponent=0)  # -> Vector, Length
cull_i = CullIndex(List=srf, Indices="0", Wrap=True)
boundary = BoundarySurfaces(Edges=srf)
boundary_2 = BoundarySurfaces(Edges=cull_i)
mesh = Mesh(boundary_2)
mesh_2 = Mesh(boundary)
image = ImageSampler(
    vec.Vector,
    FilePath="/Users/mp/Documents/GitHub/qr-art.github.io/pixel-art/assets/woman.jpg",
    Filter="Value",
    Interpolate=False,
    Umax=1,
    Umin=0,
    Vmax=1,
    Vmin=0,
    Wrap=1)
mcol = MeshColours(Mesh=mesh_2, Colours=ColourSwatch(SwatchColor=RGB(0, 0, 0)))
mcol_2 = MeshColours(Mesh=mesh, Colours=ColourSwatch(SwatchColor=RGB(255, 255, 255)))
merge = Merge(Data1=simplify(mcol), Data2=simplify(mcol_2))
mjoin = MeshJoin(Meshes=merge)  # -> flatten(Mesh)
graph = GraphMapper(
    image,
    x0=0,
    x1=1,
    y0=0,
    y1=1,
    container_name="Bezier",
    cpx=[0, 0.2348958403, 0.7163031697, 1],
    cpy=[0, 0.2858738303, 0.5684400797, 1])
tstat = TreeStatistics(Tree=srf)  # -> Paths, Length, Count
panel_3 = Panel(tstat.Count)
div = DivideDomain(Domain=Domain(0, 1), Count=panel_3)
list_2 = ValueList({"modified": 0, "original": 1}, selected="modified")
filter_2 = StreamFilter(Gate=list_2, Stream0=graph, Stream1=image)
rectangle = Rectangle(Plane=PlaneXY(0, 0, 0), XSize=target_width_mm, YSize=filter, Radius=0)  # -> Rectangle, Length
num_3 = Number(num_2)
srf_2 = Surface(rectangle.Rectangle)
fdom = FindDomain(Domains=div, Number=filter_2, Strict=False)  # -> Index, Neighbour
mesh_uv = MeshSurface(Surface=srf_2, UCount=num, VCount=num_3, Overhang=True, Equalize=False)
group = Group(Objects=srf)  # -> simplify(flatten(Group))
clr = ColorsAlpaca4d(GradientIndex=2)
data = Data(flatten(fdom.Index))
int = Integer(data)
explode = MeshExplode(Mesh=mesh_uv, Interpolate=False)
cset = CreateSet(List=int)  # -> Set, Map
panel_4 = Panel(num_3)
item = ListItem(List=group, Index=fdom.Index, Wrap=True)  # -> simplify(Item)
item_2 = ListItem(List=mjoin, Index=fdom.Index, Wrap=True)
wbfacepolys = WeaverbirdsFacePolylines(Mesh=mesh_uv)
sort_2 = SortList(Keys=cset.Set)  # -> Keys, ValuesA
ungroup = Ungroup(Group=item)  # -> simplify(Objects)
lng_3 = ListLength(List=clr)
partition = PartitionList(List=wbfacepolys, Size=panel_4)
int_2 = Integer(sort_2.Keys)
item_3 = ListItem(List=ungroup, Index=0, Wrap=True)
division_5 = Division(A=lng_3, B="7")
explode_2 = Explode(Curve=partition, Recursive=True)  # -> Segments, Vertices
mindex = MemberIndex(Set=int, Member=int_2)  # -> Index, Count
partition_2 = PartitionList(List=clr, Size=division_5)
explode_3 = Explode(Curve=item_3, Recursive=True)  # -> Segments, Vertices
entwine_2 = Entwine(
    Branch00=ColourSwatch(SwatchColor=RGB(255, 0, 255)),
    Branch01=ColourSwatch(SwatchColor=RGB(0, 255, 254)),
    Branch02=ColourSwatch(SwatchColor=RGB(0, 0, 254)),
    Branch03=ColourSwatch(SwatchColor=RGB(255, 0, 0)),
    Branch04=ColourSwatch(SwatchColor=RGB(255, 254, 0)),
    Branch05=ColourSwatch(SwatchColor=RGB(0, 255, 0)),
    FlattenInputs=True)
points = PointList()
item_4 = ListItem(List=explode, Index=mindex.Index, Wrap=True)
item_5 = ListItem(List=explode_3.Vertices, Index=0, Wrap=True)  # -> Item, Item1, Item2
item_6 = ListItem(List=explode_2.Vertices, Index=0, Wrap=True)  # -> Item, Item1, Item2
item_7 = ListItem(List=partition_2, Index=0, Wrap=True)  # -> flatten(Item)
split = SplitList(List=item_7, Index="7")  # -> ListA, ListB
pl_3pt = Plane3Pt(PointA=item_6.Item, PointB=item_6.Item1, PointC=item_6.Item2)  # -> simplify(Plane)
pl_3pt_2 = Plane3Pt(PointA=item_5.Item, PointB=item_5.Item1, PointC=item_5.Item2)  # -> simplify(Plane)
list_3 = ValueList({"gradient": 1, "random": 0}, selected="random")
graft = GraftTree(Tree=split.ListA, IncludeEmptyLists=True, IncludeNullItems=True)
pshift = ShiftPaths(Data=pl_3pt_2, Offset=-1)
pshift_2 = ShiftPaths(Data=pl_3pt, Offset=-1)
filter_3 = StreamFilter(Gate=list_3, Stream0=entwine_2, Stream1=graft)
mcol_3 = MeshColours(Mesh=item_4, Colours=filter_3)
mjoin_2 = MeshJoin(Meshes=mcol_3)
mesh_3 = Mesh(mjoin_2)
orient = Orient(Geometry=item_2, Source=pshift, Target=pshift_2)  # -> Geometry, Transform
weld = WeldMesh(Mesh=mesh_3, Angle=3.141592654)
mjoin_3 = MeshJoin(Meshes=flatten(orient.Geometry))
wbnaked = WeaverbirdsNakedBoundary(MeshClosedPolylines=weld)
mesh_4 = Mesh(mjoin_3)
